% Simulink data dictionary Senorless.sldd

MOTOR_PN = Simulink.Parameter(7, StorageClass="Define", DataType="single")  % 电机极对数
DIVSQRT3 = Simulink.Parameter(18917, StorageClass="Define", DataType="int16")  % 1/sqrt(3)*32767的值
UDC_POINT_GAIN = Simulink.Parameter(10, StorageClass="Define", DataType="int16")  % 母线电压采集后采样值与定点值换算系数做适当放大,此处为2^n
TS_POINT_GAIN = Simulink.Parameter(10, StorageClass="Define", DataType="int16")  % FOC频率的倒数适当放大,具体多少应该观察init模块中放大2^15后是多少，此处为2^n
ADC_REF = Simulink.Parameter(3.6, StorageClass="Define", DataType="single")  % ADC采样最大电压幅值，也应该为处理飘零后的范围，也应该会是总量程的一半。因为有部分ADC不能采负值所以会整体抬高一半，此时就得总量程/2=这里的数值
CURR_KI = Simulink.Parameter(380, StorageClass="Define", DataType="single")  % 电流环Ki
CURR_KP = Simulink.Parameter(0.04, StorageClass="Define", DataType="single")  % 电流环Kp
ADC_SAMPLE_MAX = Simulink.Parameter(32767, StorageClass="Define", DataType="single")  % ADC采样最大值。应注意，是考虑完ADC采回来后减去零飘后的正负范围，理论上是总量程的一半。如：LKS32中±32767代表±3.6v。
CURR_INPUT = Simulink.Parameter(3276, StorageClass="Define", DataType="int16")  % 纯电流闭环测试用，代表IMAX下对应电流的定点值
CURR_STEP = Simulink.Parameter(32760, StorageClass="Define", DataType="int16")  % 电流环每周期步进值
SPD_REDUCE = Simulink.Parameter(380, StorageClass="Define", DataType="int16")  % 每降1V少多少转速，我认为是kv值。单位：RPM
THETA_ERR_LIMIT = Simulink.Parameter(8192, StorageClass="Define", DataType="int16")  % 开环切闭环。开环角度与观测器角度误差小于这个才能切过去
CURR_POINT_GAIN = Simulink.Parameter(7, StorageClass="Define", DataType="int16")  % 相电流采集后采样值与定点值换算系数做适当放大，此处为2^n
CURR_UNDER = Simulink.Parameter(0.03, StorageClass="Define", DataType="single")  % 欠流值，为了处理出现堵住但观测器发散、实际电机电流很小的情况。单位：A
GAMMA = Simulink.Parameter(32767, StorageClass="Define", DataType="uint32")  % 非线性磁链γ值
SPD_LPF_LEVEL = Simulink.Parameter(15, StorageClass="Define", DataType="int16")  % PLL速度滤波器等级，范围0~15，越高滤波性越强
UDC_GAIN = Simulink.Parameter(21, StorageClass="Define", DataType="single")  % 母线电压分压倍数，单位：无
MOTOR_INERTIA = Simulink.Parameter(1.02e-6, StorageClass="Define", DataType="single")  % 电机转动惯量，单位：kgm^2
MOTOR_DAMPER = Simulink.Parameter(8.3e-7, StorageClass="Define", DataType="single")  % 电机阻尼，单位：Nm/rad/s
IMAX = Simulink.Parameter(34, StorageClass="Define", DataType="single")  % 电流最大值，单位：A
CURR_OVER = Simulink.Parameter(34, StorageClass="Define", DataType="single")  % 过流保护值，应注意不能大于IMAX。单位：A
LPF_FRQ = Simulink.Parameter(300, StorageClass="Define", DataType="single")  % 观测器中低通滤波器截止频率，单位：Hz
SPD_MAX = Simulink.Parameter(8100, StorageClass="Define", DataType="int32")  % 最大转速，这个为实际使用时使用标准电压正常工作所会达到的最大值，用于降压时限制最大转速。单位：RPM
AMP_GAIN = Simulink.Parameter(32, StorageClass="Define", DataType="single")  % 运算放大器倍数，是放大器中R1/(R1+R2)单位：无
CURR_LIMIT = Simulink.Parameter(1.1, StorageClass="Define", DataType="single")  % 电流环PI限幅，32767*n
MOTOR_FLUX = Simulink.Parameter(0.0012713112, StorageClass="Define", DataType="single")  % 电机磁链。单位：Wb
MOTOR_LS = Simulink.Parameter(1.8e-5, StorageClass="Define", DataType="single")  % 相电感。DQ轴电感。单位：H
MOTOR_RS = Simulink.Parameter(0.065, StorageClass="Define", DataType="single")  % 相电阻。单位：Ω
PLL_LIMIT = Simulink.Parameter(0.95, StorageClass="Define", DataType="single")  % 锁相环PI限幅，32767*n
PWM_FRQ = Simulink.Parameter(96000000, StorageClass="Define", DataType="single")  % PWM计数器频率。也可以认为是MCU时钟频率。单位：Hz
RS_HUNT = Simulink.Parameter(0.002, StorageClass="Define", DataType="single")  % 采样电阻，单位：Ω
SPD_LIMIT = Simulink.Parameter(0.8, StorageClass="Define", DataType="single")  % 速度环PI限幅，32767*n
SPD_WIDTH = Simulink.Parameter(10, StorageClass="Define", DataType="single")  % 速度环带宽.单位：Hz
UDC = Simulink.Parameter(17, StorageClass="Define", DataType="single")  % 基准母线电压，电压比这个低的时候会有些处理。单位：V
CURR_WIDTH = Simulink.Parameter(250, StorageClass="Define", DataType="single")  % 电流环带宽，可使用此计算电流环kpki，在仿真模型的初始化模块中进行选择。单位：Hz
PLL_WIDTH = Simulink.Parameter(500, StorageClass="Define", DataType="single")  % 锁相环带宽。单位：Hz
SMOK_FRQ = Simulink.Parameter(1200, StorageClass="Define", DataType="single")  % 滑模增益K，公式电角速度*磁链，即反电动势峰值。单位：Hz
FOC_FRQ = Simulink.Parameter(36000, StorageClass="Define", DataType="double")  % FOC触发频率，不能在生成代码后更改，只能在字典改。
SPD_STEP = Simulink.Parameter(3, StorageClass="Define", DataType="int32")  % 速度环步进值
OBS_SPD = Simulink.Parameter(500, StorageClass="Define", DataType="int32")  % 观测器滞环切换速度,单位：RPM
HFI_ID = Simulink.Parameter(2.125, StorageClass="Define", DataType="single")  % 低速时辅助高频注入的直流偏置。单位：A
NS_COMP_UD = Simulink.Parameter(0.531, StorageClass="Define", DataType="single")  % 极性辨识的电压值流偏置，注意，他是在电流环PI后的，所以要用[-0.5Udc,0.5udc]的电压范围来考量，也就是最多只能到一半单位：V
SPD_MIN = Simulink.Parameter(-8100, StorageClass="Define", DataType="int32")  % 进入闭环后最低目标转速，单位：RPM